# Grasshopper definition geometric_environment.gh (Grasshopper 1.0.8)

toggle_listener = BooleanToggle(False)  # disabled
reset_listener = Button()  # disabled
python_3_script = Python3Script()  # -> udp_listener; disabled
# ---------- python_3_script: Python ----------
import socket


def udp_listener(worker):
    # Define the address and port to listen on
    server_address = ("localhost", 12346)

    # Create a UDP socket
    sock = socket.socket(socket.AF_INET, socket.SOCK_DGRAM)

    # Set the socket option to reuse the address
    sock.setsockopt(socket.SOL_SOCKET, socket.SO_REUSEADDR, 1)

    # Bind the socket to the server address
    sock.bind(server_address)

    worker.display_message("Listening for incoming UDP messages...")

    try:
        while True:
            # Check if worker has requested cancellation
            if worker.has_requested_cancellation():
                worker.display_message("Cancelling listener...")
                break

            # Receive message
            data, address = sock.recvfrom(
                65535
            )  # Buffer size max is 65535, typical is 4096 bytes
            message = data.decode()

            # Update the result with the received message
            worker.update_result(message)

            # Display the received message
            # worker.display_message("Received from %s:\n%s" % (str(address), message))
            worker.display_message("Received from %s" % (str(address)))

    except Exception as e:
        # Display the error message
        worker.display_message("Error: %s" % str(e))
        worker.update_result("Error: %s" % str(e))

    finally:
        # Ensure the socket is closed properly
        sock.close()
        worker.display_message("Listener stopped.")
# ---------- end python_3_script ----------
python_3_script_2 = Python3Script(task=python_3_script, reset=reset_listener, on=toggle_listener)  # -> out, result; disabled
# ---------- python_3_script_2: Python ----------
# from __future__ import absolute_import
# from __future__ import division
# from __future__ import print_function

import threading

import Grasshopper  # type: ignore
import Rhino
import scriptcontext
import System

# from compas_ghpython import create_id

# # COMPAS 1.x compatibility
# try:
#     from compas_ghpython.timer import update_component
# except ImportError:
#     from compas_ghpython import update_component



def create_id(component, name):
    """Creates an identifier string using `name` and the ID of the component passed to it.

    The resulting string can be used to store data elements in the global sticky dictionary.
    This can be useful when setting variable in a condition activated by a button.

    Parameters
    ----------
    components : `ghpythonlib.componentbase.executingcomponent`
        The components instance. Use `self` in advanced (SDK) mode and `ghenv.Components` otherwise.
    name : str
        A user chosen prefix for the identifier.

    Returns
    -------
    str
        For example: `somename55dd-c7cc-43c8-9d6a-65e4c8503abd`

    """
    return "{}_{}".format(name, component.InstanceGuid)


def update_component(ghenv, delay):
    """Schedule an update of the Grasshopper component.

    After the specified delay, the GH component will be automatically updated.

    Parameters
    ----------
    ghenv : :class:`GhPython.Component.PythonEnvironment`
        The current GHPython environment.
    delay : :obj:`int`
        Time in milliseconds until the update is performed.

    Raises
    ------
    ValueError
        If the delay is less than zero.

    """
    if delay <= 0:
        raise ValueError("Delay must be greater than zero")

    ghcomp = ghenv.Component
    ghdoc = ghcomp.OnPingDocument()

    def callback(ghdoc):
        if ghdoc.SolutionState != Grasshopper.Kernel.GH_ProcessStep.Process:
            ghcomp.ExpireSolution(False)

    ghdoc.ScheduleSolution(
        delay, Grasshopper.Kernel.GH_Document.GH_ScheduleDelegate(callback)
    )


class BackgroundWorker(object):
    """Background worker simplifies the creation of long-running tasks inside Grasshopper.

    A long-running task is any piece of code that will run for an extended period of time,
    for example, a very complex calculation, or loading a very large data file, etc.

    To use it, write your long-running function in a Grasshopper GHPython component,
    and pass it as the input to the background worker component.
    The worker will continue working without blocking the UI.

    The following is an example of a long-running function that updates the
    progress while it runs.

    .. code-block:: python

        import time

        def do_something_long_and_complicated(worker):
            # Result can be of any data type
            result = 0

            for i in range(50):
                worker.current_value = i
                result += i
                worker.display_progress(i / (50-1))
                time.sleep(0.01)

            worker.display_message("Done!")

            return result


    Parameters
    ----------
    ghenv : ``GhPython.Component.PythonEnvironment``
        Grasshopper environment object
    long_running_function : function, optional
        This function will be the main entry point for the long-running task.
    dispose_function : function, optional
        If defined, this function will be called when the worker is disposed. It can be used for clean-up tasks
        and resource deallocation.
    auto_set_done : bool, optional
        If true, the worker state will be automatically set to ``Done`` after the function returns.
        Defaults to ``True``.
    args : tuple, optional
        List or tuple of arguments for the invocation of the ``long_running_function``. Defaults to ``()``.
    """

    def __init__(
        self,
        ghenv,
        long_running_function=None,
        dispose_function=None,
        auto_set_done=True,
        args=(),
    ):
        super(BackgroundWorker, self).__init__()
        self.ghenv = ghenv
        self._is_working = False
        self._is_done = False
        self._is_cancelled = False
        self._has_requested_cancellation = False
        self.long_running_function = long_running_function
        self.dispose_function = dispose_function
        self.auto_set_done = auto_set_done
        self.args = args

    def is_working(self):
        """Indicate whether the worker is currently working or not."""
        return self._is_working

    def is_done(self):
        """Indicate whether the worker is done or not."""
        return self._is_done

    def has_requested_cancellation(self):
        return self._has_requested_cancellation

    def request_cancellation(self):
        """Mark the current worker as cancelled, so that the background task can stop processing."""
        self._has_requested_cancellation = True

    def start_work(self):
        """Start the background processing thread where work will be performed."""

        def _long_running_task_wrapper(worker):
            try:
                worker.set_internal_state_to_working()
                result = self.long_running_function(self, *self.args)

                # There are (at least) two types of long running functions:
                # 1. Those that block the thread while working
                #    (e.g. they have a busy-wait or some kind of `while` loop)
                # 2. Those that hookup event handlers and return immediately
                #    so then they don't need to block the thread.
                # The first case means that we can set the state to "DONE"
                # right after calling the function because if it returned, it really
                # means it's done.
                # The second case will return immediately, and setting the state to "DONE"
                # would be wrong because the handlers are still going to trigger.
                # In that case we can set the flag `auto_set_done` to `False` so that
                # we don't automatically set the state to "DONE".
                if self.auto_set_done:
                    worker.set_internal_state_to_done(result)
            except Exception as e:
                worker.display_message(str(e))
                worker.set_internal_state_to_cancelled()

        target = _long_running_task_wrapper
        args = (self,)
        self.thread = threading.Thread(target=target, args=args)
        self.thread.daemon = True
        self.thread.start()

    def dispose(self):
        """Invoked when the worker is being disposed."""
        if callable(self.dispose_function):
            self.dispose_function(self)

    def set_internal_state_to_working(self):
        """Set the internal state to ``working``."""
        self._is_working = True
        self._is_done = False
        self._is_cancelled = False

    def set_internal_state_to_done(self, result):
        """Set the internal state to ``done``, which indicates the worker has completed."""
        self._is_working = False
        self._is_done = True
        self._is_cancelled = False
        self.update_result(result, delay=1)

    def update_result(self, result, delay=1):
        """Update the result of the worker.

        This will update the result of the worker, and trigger a solution expiration
        of the Grasshopper component.

        Parameters
        ----------
        result : object
            Result of the worker.
        delay : int, optional
            Delay (in milliseconds) before updating the component, by default 1.
        """
        self.result = result
        update_component(self.ghenv, delay)

    def set_internal_state_to_cancelled(self):
        """Set the internal state to ``cancelled``."""
        self._is_working = False
        self._is_done = False
        self._is_cancelled = True

    def display_progress(self, progress):
        """Display a progress indicator in the component.

        Parameters
        ----------
        progress : float
            Float between ``0..1`` indicating progress of completion.
        """
        self.display_message("Progress {:.1f}%".format(progress * 100))

    def display_message(self, message):
        """Display a message in the component without triggering a solution expiration.

        Parameters
        ----------
        message : str
            Message to display.

        """

        def ui_callback():
            self.ghenv.Component.Message = message
            self.ghenv.Component.OnDisplayExpired(True)

        Rhino.RhinoApp.InvokeOnUiThread(System.Action(ui_callback))

    @classmethod
    def instance_by_component(
        cls,
        ghenv,
        long_running_function=None,
        dispose_function=None,
        auto_set_done=True,
        force_new=False,
        args=(),
    ):
        """Get the worker instance assigned to the component.

        This will get a persistant instance of a background worker
        for a given component. The parameter `force_new` can
        be set to `True` to request a new instance to be created.

        Parameters
        ----------
        ghenv : ``GhPython.Component.PythonEnvironment``
            Grasshopper environment object
        long_running_function : function, optional
            This function will be the main entry point for the long-running task.
        dispose_function : function, optional
            If defined, this function will be called when the worker is disposed.
            It can be used for clean-up tasks and resource deallocation.
        auto_set_done : bool, optional
            If true, the worker state will be automatically set to ``Done`` after the function returns.
            Defaults to ``True``.
        force_new : bool, optional
            Force the creation of a new background worker, by default False.
        args : tuple, optional
            List or tuple of arguments for the invocation of the ``long_running_function``. Defaults to ``()``.

        Returns
        -------
        :class:`BackgroundWorker`
            Instance of the background worker of the current component.
        """

        key = create_id(ghenv.Component, "background_worker")
        worker = scriptcontext.sticky.get(key)

        if worker and force_new:
            worker.request_cancellation()
            worker.dispose()
            worker = None
            del scriptcontext.sticky[key]

        if not worker:
            worker = cls(
                ghenv,
                long_running_function=long_running_function,
                dispose_function=dispose_function,
                auto_set_done=auto_set_done,
                args=args,
            )
            scriptcontext.sticky[key] = worker

        return worker

    @classmethod
    def stop_instance_by_component(cls, ghenv):
        """Stops the worker instance assigned to the component.

        If there is no worker running, it will do nothing.

        Parameters
        ----------
        ghenv : ``GhPython.Component.PythonEnvironment``
            Grasshopper environment object
        """

        key = create_id(ghenv.Component, "background_worker")
        worker = scriptcontext.sticky.get(key)

        if worker:
            worker.request_cancellation()
            worker.dispose()
            worker = None
            del scriptcontext.sticky[key]


import threading

# import scriptcontext as sc

# from compas_eve.ghpython import BackgroundWorker
# from ghpythonlib.componentbase import executingcomponent as component


DEBUG = False


class MyComponent(Grasshopper.Kernel.GH_ScriptInstance):
    def RunScript(self, task, reset, on):
        if not on:
            BackgroundWorker.stop_instance_by_component(ghenv)  # noqa: F821
            return None

        self.worker = BackgroundWorker.instance_by_component(ghenv, task, force_new=reset)  # noqa: F821

        if not self.worker.is_working() and not self.worker.is_done() and reset:
            self.worker.start_work()

        print("Worker ID: {}".format(id(self.worker)))
        print("Is worker running? {}".format(self.worker.is_working()))
        print("Worker completed? {}".format(self.worker.is_done()))
        if hasattr(self.worker, "thread"):
            print("Worker thread: {}".format(self.worker.thread))

        if DEBUG:
            other_workers = []
            for key in scriptcontext.sticky.keys():
                if key.startswith("background_worker_"):
                    worker = scriptcontext.sticky[key]
                    if worker != self.worker:
                        other_workers.append(worker)

            if len(other_workers):
                print
                print("Found {} more workers:".format(len(other_workers)))
                for worker in other_workers:
                    print("* Worker ID: {}".format(id(worker)))
                    print(" - Is worker running? {}".format(worker.is_working()))
                    print(" - Worker completed? {}".format(worker.is_done()))
                    print(" - Worker thread: {}".format(worker.thread))

            non_main_threads = [thread for thread in threading.enumerate() if thread.name != "MainThread"]
            if len(non_main_threads):
                print
                print("Found {} background threads running:".format(len(non_main_threads)))
                for thread in non_main_threads:
                    print(" - " + thread.name)

        if hasattr(self.worker, "result"):
            return self.worker.result
        else:
            return None
# ---------- end python_3_script_2 ----------
panel = Panel(python_3_script_2.out)  # disabled

# ---- group: run generated script
run_script = Python3Script(script=python_3_script_2.result)  # -> out, geometry_states; unedited script template

# ----
brep = Brep(run_script.geometry_states)

# ---- group: generated script
panel_2 = Panel(python_3_script_2.result)  # disabled

# ----
cluster = Cluster(objects=brep)
remove_invalid = Python3Script(mesh=cluster)  # -> out, result; inputs mesh: tree of Mesh
# ---------- remove_invalid: Python ----------
import Rhino.Geometry as rg
import ghpythonlib.treehelpers as tree

# force datatree to be {0;?}
path_struct = {}
for path in mesh.Paths:
    items = mesh.Branch(path)
    if f'{path.Indices[1]}' in path_struct:
        path_struct[f'{path.Indices[1]}'].extend(items)
    else:
        path_struct[f'{path.Indices[1]}'] = list(items)

# from dict to list[list]
keys = sorted(list(path_struct.keys()))
mesh = [path_struct[key] for key in keys]

result = [[m for m in bm if m.IsValid] for bm in mesh]
result = tree.list_to_tree(result)
# ---------- end remove_invalid ----------
save_obj = Python3Script(mesh=remove_invalid.result)  # -> out, obj_file_paths; inputs mesh: tree of Mesh
# ---------- save_obj: Python ----------
import os
import Grasshopper
import Rhino
import System
from Rhino.FileIO import FileObj, FileObjWriteOptions, FileWriteOptions
import uuid
import ghpythonlib.treehelpers as tree

# set the write options
write_options = FileWriteOptions()
write_options.WriteSelectedObjectsOnly = True
write_options.SuppressDialogBoxes = True
# https://developer.rhino3d.com/api/rhinocommon/rhino.fileio.fileobjwriteoptions
obj_options = FileObjWriteOptions(write_options)
obj_options.CullUnnecessaryVertexesInNgons = True
obj_options.EolType = FileObjWriteOptions.AsciiEol.Crlf
obj_options.ExportAsTriangles = False
# obj_options.ExportGroupNameLayerNames = FileObjWriteOptions.ObjGroupNames.NoGroups
obj_options.ExportMaterialDefinitions = False
obj_options.ExportNormals = False
# obj_options.ExportObjectNames = FileObjWriteOptions.ObjObjectNames.NoObjects
obj_options.ExportOpenMeshes = True
obj_options.ExportTcs = False
obj_options.ExportVcs = False
obj_options.UseSimpleDialog = False
obj_options.IncludeUnweldedEdgesInNgons = False
obj_options.MapZtoY = True
obj_options.MeshType = FileObjWriteOptions.VertexWelding.Normal
obj_options.ObjectType = FileObjWriteOptions.GeometryType.Mesh
obj_options.SignificantDigits = 16
obj_options.WrapLongLines = False

# get current gresshopper definition path
dir_name = os.path.dirname(ghenv.Component.OnPingDocument().FilePath)

obj_file_paths = []
count = 0

for iteration in tree.tree_to_list(mesh):
    mesh_list = [m for m in iteration if m]
    if len(mesh_list) >= 1:
        padded_index = str(count).zfill(2)
        file_name = f"mesh_{padded_index}.obj"
        full_path = os.path.join(dir_name, file_name)
        # Write the mesh to the file
        FileObj.Write(full_path, meshes=list(mesh_list), options=obj_options)
        # Add the file path to the list
        obj_file_paths.append(full_path)
        # Add counter
        count += 1
# ---------- end save_obj ----------
send = Python3Script(obj_str=save_obj.obj_file_paths)  # -> out, a; inputs obj_str: list of String
# ---------- send: Python ----------
import json
import socket
from Grasshopper.Kernel import GH_RuntimeMessageLevel as rml
import Grasshopper
import System

doc = ghenv.Component.OnPingDocument()
comps = list(doc.Objects)
rsc = None

for com in comps:
    if com.NickName == 'run_script':
        rsc = com

def send_data(data):
    # Create a UDP socket
    udp_socket = socket.socket(socket.AF_INET, socket.SOCK_DGRAM)
    server_address = ("localhost", 12347)
    udp_socket.sendto(data, server_address)
    # s.send(data)
    udp_socket.close()

class MyComponent(Grasshopper.Kernel.GH_ScriptInstance):
    def RunScript(self, obj_str: System.Collections.Generic.List[str]):
        script_log_data = 'success'
        
        # Check run script component runtime message
        if rsc:
            if rsc.RuntimeMessageLevel in (rml.Error, rml.Warning):
                script_log_data = 'Error: ' + ','.join(rsc.RuntimeMessages(rsc.RuntimeMessageLevel))
            else:
                # Check if mesh export list is empty
                if len(obj_str) == 0:
                    script_log_data = 'Error: Generated invaild geometries, try again.'
        else:
            raise Exception('run_script component not found!')

        # obj_data = obj_str.encode()
        data = {
            "script_log": script_log_data,
            "obj_file_paths": list(obj_str),
        }
        data = json.dumps(data)
        send_data(data.encode())

        a = data
        return data
# ---------- end send ----------
panel_3 = Panel(send.a)

# ==== cluster Cluster
objects = ClusterInput()
bounding_box = BoundingBox(Content=objects, Plane=PlaneXY(0, 0, 0), UnionBox=True)  # -> Box, Box_2
box_properties = BoxProperties(Box=bounding_box.Box)  # -> Center, Diagonal, Area, Volume, Degeneracy
null_item = NullItem(Item=objects)  # -> NullFlags, InvalidFlags, Description
vector_length = VectorLength(Vector=box_properties.Diagonal)
cull_pattern = CullPattern(List=objects, CullPattern=invert(null_item.NullFlags))
multiplication = Multiplication(A=vector_length, B=Slider(0.001, range=0..0.01))
settings_custom = SettingsCustom(
    StitchSeams=True,
    SimplePlanes=False,
    Refine=True,
    MinCount=16,
    MaxCount=400,
    AspectRatio=20,
    MaxDistance=0,
    MaxAngle=20,
    MinEdge=multiplication,
    MaxEdge=0)
mesh_brep = MeshBrep(Brep=cull_pattern, Settings=settings_custom)
meshes = ClusterOutput(mesh_brep)
